% Simulink data dictionary TractionEmotorSoftwareArchInterfaceData.sldd

CSOC_DataBus = Simulink.Bus()
  Phase_currents_offset_100us: double
  Current_sensor_diagEnbl_2ms: boolean
  Current_sensor_caliDone_2ms: boolean
  Current_offset_valid_2ms: boolean

DQRC_DataBus = Simulink.Bus()
  Id_cmd_100us: double
  Iq_cmd_100us: double
  Is_cmd_100us: double
  Ud_fdfrward_cmd_100us: double
  Uq_fdfrward_cmd_100us: double
  Power_factor_angle_100us: double
  Rs_calibrated_2ms: double
  Tmax_mot_2ms: double
  Tmax_gen_2ms: double

PSCC_DataBus = Simulink.Bus()
  Motor_elecSpeed_100us: double
  Motor_elecPosition_100us: double
  Motor_elecSpeed_2ms: double
  Motor_elecPosition_2ms: double
  Motor_mechSpeed_2ms: double
  PosSpeed_unknown_2ms: boolean

PWMC_DataBus = Simulink.Bus()
  Inverter_status_cmd_100us: boolean
  Idc_estimate_100us: double
  Duty_cycle_A_100us: double
  Duty_cycle_B_100us: double
  Duty_cycle_C_100us: double
  Idc_estimate_2ms: double

SFCC_DataBus = Simulink.Bus()
  Ts_final_100us: double
  Ts_final_2ms: double
  Switching_freq_final_2ms: double

SMDC_DataBus = Simulink.Bus()
  System_mode_100us: Enum: SystemState
  System_mode_2ms: Enum: SystemState
  Fault_action_2ms: boolean
  Resolver_reset_req_2ms: boolean
  Inverter_state_cmd_2ms: boolean
  Discharg_active_2ms: boolean
  Regen_active_2ms: boolean

TAEC_DataBus = Simulink.Bus()
  Torque_achieved_2ms: double
  TorqueEst_powerBased_2ms: double
  Positive_id_check_2ms: double

VSOC_DataBus = Simulink.Bus()
  Voltage_sensor_diagEnbl_2ms: boolean
  HV_sensor_status_2ms: boolean
  HV_sensorOffset_2ms: double
  Voltage_sensor_caliDone_2ms: boolean

REDC_DataBus = Simulink.Bus()
  REDC_resolver_status_100us: Enum: ResolverState
  REDC_shaftPos_filtered_100us: double
  REDC_faultStatus_100us: boolean

STDC_DataBus = Simulink.Bus()
  STDC_ctrlBoard_temp_2ms: double
  STDC_phaseTemp_max_2ms: double
  STDC_IGBTTemp_max_2ms: double
  STDC_motorTemp_2ms: double
  STDC_faultStatus_2ms: double

MFDC_DataBus = Simulink.Bus()
  MFDC_openCircuit_fault_2ms: double
  MFDC_overSpeed_fault_2ms: double
  MFDC_achievedTrq_fault_2ms: double
  MFDC_faultStatus_2ms: boolean

VSDC_DataBus = Simulink.Bus()
  PowerOn_12V_status_2ms: boolean
  PowerOn_5V_status_2ms: boolean
  PowerOn_3V_status_2ms: boolean
  Emergency_stop_status_2ms: boolean
  Vehicle_idle_status_2ms: boolean
  Vehicle_stop_status_2ms: boolean
  Crash_signal_status_2ms: boolean
  VSDC_faultStatus_2ms: double

TDLC_DataBus = Simulink.Bus()
  Trq_cmd_final_2ms: double
  Is_maxABS_2ms: double
  Max_torque_2ms: double
  Min_torque_2ms: double

IHDC_DataBus = Simulink.Bus()
  IHDC_PhaseA_current_100us: double
  IHDC_PhaseB_current_100us: double
  IHDC_3phase_status_2ms: boolean
  IHDC_Vdc_filtered_2ms: double
  IHDC_Idc_2ms: double
  IHDC_IGBTbias_fault_2ms: boolean
  IHDC_gateDriver_fault_2ms: boolean
  IHDC_faultStatus_2ms: boolean
  IHDC_Discharge_req_2ms: double
  Inverter_overCurrent_2ms: boolean

CRFC_DataBus = Simulink.Bus()
  Is_achieved_2ms: double
  Modulation_index_2ms: double
  Isd_feedback_2ms: double
  Isq_feedback_2ms: double
  Is_alpha_100us: double
  Is_beta_100us: double
  Isd_feedback_100us: double
  Isq_feedback_100us: double
  Usd_ctrl_100us: double
  Usq_ctrl_100us: double
  Phase_current_rms_2ms: double

STMC_DataBus = Simulink.Bus()
  Trq_cmd_2ms: double
  Trq_cmd_ramp_2ms: double
  Trq_negRamp_active_2ms: boolean

ROCC_DataBus = Simulink.Bus()
  Resolver_elecPos_actual_100us: double
  Us_inject_alpha_100us: double
  Us_inject_beta_100us: double
  Resolver_cal_enbl_2ms: boolean
  Resolver_value_valid_2ms: boolean
  Resolver_offeset_value_2ms: double
  RDC_faultStatus_2ms: double
  SineCosine_faultStatus_2ms: double

SystemState = enum(DefaultValue="Wake")
  Wake = 0
  Standby = 1
  Idle = 2
  Run = 3
  Diagnostics = 4
  Fault = 5

ResolverState = enum(DefaultValue="Schedule")
  Schedule = 0
  Run = 1
  Interrupt = 2
  Finish = 3
  Reset = 4

BatteryState = enum(DefaultValue="Standby")
  Standby = 0
  Charging = 1
  Driving = 2
  Fault = 3

CIDC_DataBus = Simulink.Bus()
  CIDC_coolant_temp_2ms: double
  CIDC_outside_airTemp_2ms: double
  CIDC_torque_cmd_2ms: double
  CIDC_speed_cmd_2ms: double
  CIDC_chargeVolt_2ms: double
  CIDC_battery_status_2ms: boolean
  CIDC_busVoltage_drop_2ms: double
  CIDC_HV_contactorStatus_2ms: boolean